# Grasshopper definition AsyncHandson.gh (Grasshopper 1.0.7)
# plug-ins: GrasshopperAsyncComponentDemo

depth = Slider(28, range=0..1000)
number_slider = Slider(23, range=0..100)
angle = Slider(22, range=0..90)
height = Slider(100, range=0..100)
width = Slider(4, range=1..20)
subtraction = Subtraction(A=number_slider, B="1")
subtraction_2 = Subtraction(A="180", B=angle)
series = Series(Start=depth, Step=depth, Count=number_slider)
range = Range(Domain=Domain(0, 1), Steps=subtraction)
rad = Radians(Degrees=angle)
graph = GraphMapper(range, x0=0, x1=1, y0=0, y1=1, Cx=0.5072463751, Cy=0.4927536249, container_name="Conic")
rad_2 = Radians(Degrees=subtraction_2)
dom = ConstructDomain(DomainStart=rad, DomainEnd=rad_2)
arc = Arc(Plane=PlaneXY(0, 0, 0), Radius=series, Angle=dom)  # -> Arc, Length
multiplication = Multiplication(A=graph, B=height)
Z = UnitZ(Factor=multiplication)
move = Move(Geometry=arc.Arc, Motion=Z)  # -> Geometry, Transform
len = Length(Curve=move.Geometry)
division = Division(A=len, B=width)
round = Round(Number=division)  # -> Nearest, Floor, Ceiling
divide = DivideCurve(Curve=move.Geometry, Count=round.Floor, Kinks=False)  # -> flatten(Points), Tangents, Parameters
target = Panel("0,0,0")
radius = Panel("2")
lng = ListLength(List=divide.Points)
c_script = CSharpScript(points=divide.Points, target=target, radius=radius)  # -> out, Results; inputs points: list of Point3d, target: Point3d, radius: Double; disabled
# ---------- c_script: C# ----------
    var oResults = new List<int>();
    List<Sphere> TestSpheres = new List<Sphere>();
    for(int i = 0; i < points.Count;i++)
    {
      TestSpheres.Clear();
      for(int j = 0;j < points.Count;j++)
      {
        if(i != j){TestSpheres.Add(new Sphere(points[j], radius));}
      }
      var res = CheckSightLine(points[i], TestSpheres, target);
      oResults.Add(res);
    }
    Results = oResults;
# ---------- c_script: C# additional code ----------
  public int CheckSightLine(Point3d pt, List<Sphere> TestSpheres, Point3d target)
  {
    var count = 0;
    var l = new Line(pt, target);
    Point3d pt1;
    Point3d pt2;
    for (int i = 0;i < TestSpheres.Count;i++)
    {
      var events = Rhino.Geometry.Intersect.Intersection.LineSphere(l, TestSpheres[i], out pt1, out pt2);
      if (events != Rhino.Geometry.Intersect.LineSphereIntersection.None){count += 1;}
    }
    return count;
  }


  /// <summary>
  /// This method will be called once every solution, before any calls to RunScript.
  /// </summary>
  /// <summary>
  /// This method will be called once every solution, after any calls to RunScript.
  /// </summary>
# ---------- end c_script ----------
points = Panel(lng)
async_sightline = AsyncSightline(Points=divide.Points, Target=target, Radius=radius)
sightline = Sightline(Points=divide.Points, Target=target, Radius=radius)  # disabled
sort = SortList(Keys=async_sightline)  # -> Keys, ValuesA
item = ListItem(List=sort.Keys, Index=0, Wrap=True)  # -> Item1, Item
ln = Line(StartPoint=divide.Points, EndPoint=target)
gradient = Gradient(
    LowerLimit=item.Item1,
    UpperLimit=item.Item,
    Parameter=async_sightline,
    stops=[0: RGB(234, 38, 0), 0.25: RGB(234, 126, 0), 0.5: RGB(254, 244, 84), 0.75: RGB(173, 203, 249), 1: RGB(75, 107, 169)])
preview = CustomPreview(Geometry=ln, Material=gradient)
preview_2 = CustomPreview(Geometry=divide.Points, Material=gradient)
preview_3 = CustomPreview(Geometry=target, Material=ColourSwatch(SwatchColor=RGB(255, 255, 255)))
